# Grasshopper definition PlugInSolar_Example.ghx (Grasshopper 1.0.8)
# plug-ins: Plug-In Solar

# ---- group: 01 | Location + sample weather
# PLUG-IN SOLAR | First simulation
# Berlin / 21 June 2026 / 800 W DC
# Synthetic clear-sky example, not an annual yield forecast.
site = Location(Latitude="52.52", Longitude="13.405", Timezone="Europe/Berlin", Altitude_m="34")
# HOW TO USE
# Edit the white input panels. Read left to right.
# Panel normal: south-facing, 30-degree tilt.
# Power defaults: 20 C air, 1 m/s wind, 14% losses.
# Hourly interval / expected energy: about 4.843 kWh.
panel = Panel("2026-06-21")
clearsky = ClearSky(Site=site, Start=panel, End="2026-06-22", Step_minutes="60")  # -> Weather, Timestamps

# ---- group: 02 | Sun + panel orientation
# Panel front normal
# (0, -0.5, 0.8660254)
# Stored on normal input; right-click to edit.
sun = SunPosition(Site=site, Weather=clearsky.Weather)  # -> Solar, Altitude_deg, Azimuth_deg
panel_2 = PanelOrientation(Normal=Vector(0, -0.5, 0.8660254), North_deg=0)  # -> Tilt_deg, Azimuth_deg
panel_tilt_degrees = Panel(panel_2.Tilt_deg)

# ---- group: 03 | Irradiance + PV power
poa = PanelIrradiance(Weather=clearsky.Weather, Solar=sun.Solar, Tilt_deg=panel_2.Tilt_deg, Azimuth_deg=panel_2.Azimuth_deg, Albedo=0.2)  # -> Poa, Poa_w_m2
power = PVPower(Poa=poa.Poa, Dc_capacity_w="800", Ac_limit_w="800", Air_temp_c=20, Wind_m_s=1, Gamma_pdc=-0.004, Losses_pct=14)  # -> Power, Dc_w, Ac_w

# ---- group: 04 | Energy results
energy = EnergyYield(Power=power.Power, Step_hours="1")
hourly_ac_power_w = Panel(power.Ac_w)
ac_energy_kwh = Panel(energy)
